# Grasshopper definition test.gh (Grasshopper 1.0.7)
# plug-ins: BITS

file_path = FilePath("C:\Users\Nirvik Saha\source\repos\BITS\bin\data\wall_door_jsonLD_data.json")
file_path_2 = FilePath("C:\Users\Nirvik Saha\source\repos\BITS\bin\data\wall_door_framing4.json")
file_path_3 = FilePath("C:\Users\Nirvik Saha\source\repos\BITS\bin\data\TO_XML_data_wall_door.json")
# JSON LD Framing
jsonld_framing = JsonLD_Framing(PathToIfcJsonFile=file_path, PathToJsonFrame=file_path_2)  # disabled
jsontoxml = JsonToXML(PathToJsonFile=file_path_3)  # disabled
panel = Panel(jsonld_framing)
# json TO xml
panel_2 = Panel(jsontoxml)
