# Grasshopper definition test2.gh (Grasshopper 1.0.7)
# plug-ins: BITS

# ----
# Format JSON
panel = Panel("{\"@context\": {\"@vocab\": \"http://bsi.org/ifc/4x3/\",\"@base\": \"http://myfile.org/ids/\",\"ref\": \"@id\",\"data\": \"@graph\",\"type\": \"@type\",\"globalId\": \"@id\"}}")
jsonformattingmain = JsonFormattingMain(InputJson=panel)
panel_2 = Panel(jsonformattingmain)

# ----
# File - input ifcJson data
# Text- Frame definition
panel_3 = Panel("""{
    "@context": {
      "@vocab": "http://bsi.org/ifc/4x3/",
      "@base": "http://myfile.org/ids/",
      "ref": "@id",
      "data": "@graph",
      "type": "@type",
      "globalId": "@id"
    },
    "@type": "IfcProject",
    "@explicit": true,
    "isDecomposedBy": {
      "@explicit": true,
      "relatedObjects": {
        "@explicit": true,
        "containsElements": {
          "@explicit": true,
          "relatedElements": {
            "@explicit": true,
            "isNestedBy": {
              "@explicit": true,
              "relatedObjects": {
                "@explicit": true
              }
            }
          }
        }
      }
    }
  }""")
file_path = FilePath("C:\Users\Nirvik Saha\Documents\PostDoc\jsonLD\wall_door_data\data_framing\wall_door.json")
jsonld_framing_text = JsonLD_Framing_Text(InputIfcJsonLD=file_path, InputFrameDefinition=panel_3)  # -> OutputFramedData, Debug
panel_4 = Panel(jsonld_framing_text.Debug)
panel_5 = Panel(jsonld_framing_text.OutputFramedData)

# ----
# Compacted
panel_6 = Panel("""{
  "@context": {
    "@vocab": "http://bsi.org/ifc/4x3/",
    "@base": "http://myfile.org/ids/",
    "ref": "@id",
    "data": "@graph",
    "type": "@type",
    "globalId": "@id"
  }
}""")
file_path_2 = FilePath("C:\Users\Nirvik Saha\source\repos\BITS\bin\data\context.json")
file_path_3 = FilePath("C:\Users\Nirvik Saha\Documents\PostDoc\jsonLD\wall_door_data\data_framing\wall_door.json")
jsonld_compacted = JsonLDCompacted(PathToIfcJsonFile=file_path_3, ContextJsonViaPanel=panel_6)
panel_7 = Panel(jsonld_compacted)

# ----
# Expanded
# (Careful - will slow down)
file_path_4 = FilePath("C:\Users\Nirvik Saha\Documents\PostDoc\jsonLD\wall_door_data\data_framing\wall_door.json")
json_ld_expanded = JsonLDExpanded(PathToIfcJsonFile=file_path_4)  # disabled
panel_8 = Panel(json_ld_expanded)

# ----
# Flattened
panel_9 = Panel("""{
  "@context": {
    "@vocab": "http://bsi.org/ifc/4x3/",
    "@base": "http://myfile.org/ids/",
    "ref": "@id",
    "data": "@graph",
    "type": "@type",
    "globalId": "@id"
  }
}""")
file_path_5 = FilePath("C:\Users\Nirvik Saha\source\repos\BITS\bin\data\context.json")
file_path_6 = FilePath("C:\Users\Nirvik Saha\Documents\PostDoc\jsonLD\wall_door_data\data_framing\wall_door.json")
json_ld_flattened = JsonLDFlattened(PathToIfcJsonFile=file_path_6, ContextJsonViaPanel=panel_9)
panel_10 = Panel(json_ld_flattened)

jsonwritetofile = JsonWriteToFile(
    PathDirToFile="C:\Users\Nirvik Saha\Documents\PostDoc",
    NameOfTheFile="helloBits.json",
    InputJsonViaPanelText="{a:1,b:2,c:3,d:[1,2,3,4]}")
panel_11 = Panel(jsonwritetofile)
