# Grasshopper definition testGeom.gh (Grasshopper 1.0.7)
# plug-ins: BITS

file_path = FilePath("C:\Users\Nirvik Saha\source\repos\BITS\bin\data\test_X.json")
gen_geometry = GenGeometry(PathToIfcJsonFile=file_path)  # -> OutputGeometry, Debug
panel = Panel(gen_geometry.Debug)
sphere = Sphere(Base=gen_geometry.OutputGeometry, Radius=Slider(1, range=1..10))
