# Grasshopper definition webApi.gh (Grasshopper 1.0.7)
# plug-ins: BITS

sample_ifc_json = SampleIfcJson(InputURL="https://ifcpyserver.azurewebsites.net/get/test", StartProcess=Toggle(True))
sample_ifc_json_2 = SampleIfcJson(InputURL="https://ifcpyserver.azurewebsites.net/post/test", StartProcess=Toggle(True))
# set a file path to any *.ifc file (revit export)
# 
# right click on "file path" component and
# "Set File Path". This opens a file dialog.
file_path = FilePath("C:\Users\Nirvik Saha\source\repos\BITS\bin\data\wall_door.ifc")
ifc_json_from_step = IfcJsonFromStep(InputIFCFile=file_path, InputURL="https://ifcpyserver.azurewebsites.net/post/data", StartProcess=Toggle(True))  # disabled
panel = Panel(sample_ifc_json)
panel_2 = Panel(sample_ifc_json_2)
sample_ifc_json_3 = SampleIfcJson(InputURL="https://ifcpyserver.azurewebsites.net/get/data", StartProcess=Toggle(True))  # disabled
# directly view the json
# (will slow down GH)
panel_3 = Panel(ifc_json_from_step)
# directly view the json
# (will slow down GH)
panel_4 = Panel(sample_ifc_json_3)
# write to file and review the data
panel_5 = Panel("C:\Users\Nirvik Saha\source\repos\BITS\bin\data")
# write to file and review the data
panel_6 = Panel("C:\Users\Nirvik Saha\source\repos\BITS\bin\data")
jsonwritetofile = JsonWriteToFile(PathDirToFile=panel_5, NameOfTheFile="dataFromServer", InputJsonViaPanelText=ifc_json_from_step)
jsonwritetofile_2 = JsonWriteToFile(PathDirToFile=panel_6, NameOfTheFile="dataFromServer", InputJsonViaPanelText=sample_ifc_json_3)
panel_7 = Panel(jsonwritetofile)
panel_8 = Panel(jsonwritetofile_2)
